# Dynamo graph SampleDynamoExport.dyn (Dynamo 1.2.1.3083)

boolean = BoolSelector(true)
directory_path = Directory("C:\Users\wwong\Desktop")
code_block = CodeBlock { "spectacles"; }
number_slider = DoubleSlider(10, range=0..100 step 0.1)
byLengths = Cuboid.ByLengths(width=number_slider, length=number_slider, height=number_slider)
byGeometry = Autodesk.Dynamo.MeshToolkit.Mesh.ByGeometry(byLengths)
code_block_2 = CodeBlock { 255; }
byARGB = Color.ByARGB(r=code_block_2)
byToolkitMeshAndColor = Spectacles.DynamoExporter.SpectaclesMesh.ByToolkitMeshAndColor(byGeometry, byARGB)
create = List.Create(byToolkitMeshAndColor)
sceneCompiler = Spectacles.DynamoExporter.Spectacles.SceneCompiler(boolean, directory_path, code_block, create)
watch = Watch(sceneCompiler.out0)
watch_2 = Watch(sceneCompiler.out1)
watch_3 = Watch(byGeometry)
boolean_2 = BoolSelector(false)
launch = Spectacles.DynamoExporter.Spectacles.Launch(boolean_2)
